# Requirement set Team01_Requirements (R2025b)

## 1 [Cat1] Mission Capability

### 1.1 [R1] Takeoff Distance
Aircraft shall be fully airborne within 25 meters of the start line under its own power.
Rationale: From the RFP
Verification Method: Test

### 1.2 [R2] Post Climb Altitude
Aircraft shall climb to 30 meters of altitude after taking off.
Rationale: From the RFP
Verification Method: Test

### 1.3 [R3] Lap
Aircraft shall complete 3 full laps of the course portrayed in the RFP.
Rationale: From the RFP
Verification Method: Test

### 1.4 [R4] Stability
Aircraft shall be stable when crossing the runway center-mark on lap 3.
Rationale: From the RFP
Verification Method: Demonstration

### 1.5 [R5] Safe Landing
Aircraft shall land on a dirt surface with grass up to 10 centimeters without incurring significant damage that prevents a reflight.
Rationale: From the RFP
Verification Method: Test

## 2 [Cat2] Safety & Environment

### 2.1 [R6] Prevent Injury and Damage
Aircraft shall complete the mission profile without damage to humans, vegetation, wildlife, and private property.
Rationale: From the RFP
Verification Method: Demonstration

### 2.2 [R7] Battery Connection
Aircraft shall be designed such that the battery can be connected without removing any aircraft components.
Rationale: From the RFP
Verification Method: Demonstration

### 2.3 [R8] Propeller Clearance
Aircraft shall be designed such that the battery can be connected without any appendage entering the propeller volume.
Rationale: From the RFP
Verification Method: Demonstration

## 3 [Cat3] Ground Operations and Storage

### 3.1 [R9] Storage Volume
Aircraft shall fit within a volume of 75x75x150 cm when stored.
Rationale: From the RFP
Verification Method: Inspection

### 3.2 [R10] Wingspan
Aircraft wingspan shall not exceed 150 cm.
Rationale: From the RFP
Verification Method: Inspection

### 3.3 [R11] Configuration Change
Aircraft shall be able to go from storage to flight-ready in less than 5 minutes, excluding battery & payload integration.
Rationale: From the RFP
Verification Method: Test

### 3.4 [R12] Battery & Payload Install Time
Aircraft shall be designed such that the payload and battery install time is no longer than 2 minutes.
Rationale: From the RFP
Verification Method: Test

### 3.5 [R13] Battery Access
Aircraft shall be designed such that the removal of any panel covering the battery can be done without any tooling.
Rationale: From the RFP
Verification Method: Demonstration

### 3.6 [R29] Repairability
Aircraft shall be designed such that dis-assembling and replacing components can be performed within a 1-hour timeframe.
Rationale: Team-added, ensures any flight-testing failures can be easily fixed without preventing a re-flight.
Verification Method: Demonstration

## 4 [Cat4] Payload Capacity

### 4.1 [R14] Payload Capacity
Aircraft shall be designed such that a minimum of 1 payload with cubic dimension of 50.8 mm (+/- 1mm) per side and mass of 520g (+/- 10g) can be carried on board throughout the mission.
Rationale: From the RFP
Verification Method: Demonstration

### 4.2 [R15] Payload & Battery Mounting
Aircraft shall retain the battery and payload securely throughout the complete mission profile.
Rationale: From the RFP
Verification Method: Test

### 4.3 [R16] Battery/Payload Modifications
Aircraft’s payload and battery mounting schemes shall not require any modifications.
Rationale: From the RFP
Verification Method: Inspection

## 5 [Cat5] Flight Test

### 5.1 [R17] Aircraft-Payload Stability
Aircraft shall remain stable when carrying the payload during the complete mission profile.
Rationale: From the RFP
Verification Method: Test

### 5.2 [R18] Aircraft-No Payload Stability
Aircraft shall remain stable when flown without payload during the complete mission profile.
Rationale: From the RFP
Verification Method: Test

### 5.3 [R19] Flyability
Aircraft shall be flyable by a pilot that is not part of the team
Rationale: From the RFP
Verification Method: Test

### 5.4 [R20] Flight Data
Aircraft’s avionics system shall record and download GPS altitude, climb rate, airspeed, distance flown, groundspeed, barometric altitude, load factor, turn rate, and roll rate during the complete mission profile.
Rationale: From the RFP
Verification Method: Test

### 5.5 [R21] Propulsion Power
Aircraft’s propulsion system shall not draw more than 1000W of electrical power at any point during the complete mission profile.
Rationale: From the RFP
Verification Method: Test

### 5.6 [R26] Multiple Flights
The aircraft shall complete 3 consecutive takeoff and landings without requiring structural repairs
Rationale: Team-added, timeline is limited and flight tests will be performed prior to the final evaluation. Proves design robustness to multiple cycles of flight.
Verification Method: Test

### 5.7 [R27] Tracking
Aircraft’s exterior shall provide contrast with the flight environment for the pilot to easily track during flight at a max distance of 200 m.
Rationale: Team-added, ensures flight failure will not occur due to momentary lack of pilot feedback control due to lack of aircraft visibility.
Verification Method: Inspection

## 6 [Cat6] Program Constraints

### 6.1 [R22] Maximum Take Off Weight
Aircraft’s MTOW shall not exceed 6 kg mass
Rationale: From the RFP
Verification Method: Inspection

### 6.2 [R23] Budget
The total cost of the aircraft assembly shall be no more than $400.
Rationale: From the RFP
Verification Method: Inspection

### 6.3 [R24] Schedule
Aircraft shall be ready for flight by Week 12 of the semester.
Rationale: From the RFP
Verification Method: Inspection

### 6.4 [R25] As-Built Justifications
Any externally sourced component shall be rationalized and submitted to the instructional team.
Rationale: From the RFP
Verification Method: Inspection

### 6.5 [R28] Weight Margin
Aircraft’s as-designed mass shall not exceed 90% of the MTOW of 6kg.
Rationale: Team-added, ensures any as-built mass deviations remain under the MTOW requirement.
Verification Method: Inspection