# Requirement set Team01_StakeholderNeeds (R2025b)

## 1 [Cat1] Mission Capability (Container)

### 1.1 [N1] Runway Takeoff
The customer needs the aircraft to take off from the runway unassisted.
Source: RFP: Project objectives

### 1.2 [N2] Lap Count
The customer needs the aircraft to complete three full laps of the marked course.
Source: RFP: Project Objectives

### 1.3 [N3] Cruising Altitude
The customer needs the aircraft to reach a safe cruising altitude after takeoff
Source: RFP: Project requirements

### 1.4 [N4] Stable Approach
The customer needs the aircraft to perform a stabilized approach after the final lap
Source: RFP: Project Requirements

### 1.5 [N5] Landing
The customer needs the aircraft to land on an unimproved grassy surface without damaging the aircraft
Source: RFP: Project Objectives

### 1.6 [N6] Takeoff
The customer needs the aircraft to take off within a short length of runway
Source: RFP: Project Objectives

## 2 [Cat2] Safety & Environment

### 2.1 [N7] Environment Safety
The customer needs the aircraft to not create any risk of damage or injury to nearby people, wildlife, vegetation, and private property during the complete mission profile.
Source: RFP: Project Objectives

### 2.2 [N8] Battery Unobstructed
The customer needs the handling of the battery to create no risk of touching the aircraft’s propeller.
Keywords: RFP: Project Objectives
Source: RFP: Project Objectives

## 3 [Cat3] Ground Operation & Storage

### 3.1 [N9] Volume Limits
The customer needs to be able to store the aircraft in a particular volume.
Keywords: RFP: Project Objectives
Source: RFP: Project Objectives

### 3.2 [N10] Flight Readiness
The customer needs to be able to go from stored to flight-ready in a short time frame.
Keywords: RFP: Project Objectives
Source: RFP: Project Objectives

### 3.3 [N11] Payload Integration
The customer needs to be able to integrate the battery and payload in a short time frame at the field.
Source: RFP: Project Objectives

### 3.4 [N12] Battery Accessibility
The customer needs to be able to access the battery without any tooling.
Source: RFP: Project Objectives

### 3.5 [N26] Repairability
The customer needs the aircraft’s structure to be easily built for potential part replacements post-flight tests.
Source: Team-Added

## 4 [Cat4] Payload & Battery

### 4.1 [N13] Payload Requirement
The customer needs the aircraft to be able to carry at least 1 payload during the complete mission profile.
Source: RFP: Project Objectives

### 4.2 [N14] Undamaged Components
The customer needs the payload and battery to remain undamaged during the complete mission profile.
Source: RFP: Project Objectives

### 4.3 [N15] Unmodified Components
The customer needs the payload and battery to be usable without any modifications.
Source: RFP: Project Objectives

## 5 [Cat5] Flight Test
Source: RFP: Project Objectives

### 5.1 [N16] Payload
The customer needs the aircraft to be stable independent of carrying a payload or not.
Source: RFP: Project Objectives

### 5.2 [N17] Pilotable
The customer needs the aircraft to controllable and flyable by a pilot who is not part of the design team.
Source: RFP: Project Objectives

### 5.3 [N18] Telemetry
The customer needs to be able to record and download flight telemetry gathered during flights pertaining to performance and dynamic data.
Source: RFP: Project Objectives

### 5.4 [N23] Durability
The customer needs the aircraft to fly multiple times without the need of making edits or repairs to the structure.
Source: Team-Added

### 5.5 [N24] Visibility
The customer needs the aircraft to be visible throughout the complete mission profile
Source: Team-Added

## 6 [Cat6] Program Constraints

### 6.1 [N19] Budget
The customer needs the aircraft to be designed and built within the available budget.
Source: RFP: Project Objectives

### 6.2 [N20] Schedule
The customer needs the aircraft to be ready for flights within the semester schedule set forward.
Source: RFP: Project Objectives

### 6.3 [N21] Rationalization
The customer needs any deviation in the build to be rationalized before use.
Source: RFP: Project Objectives

### 6.4 [N22] Performance Limits
The customer needs the aircraft to meet physical and performance limits.
Source: RFP: Project Objectives

### 6.5 [N25] Design Margin
The customer needs design to accommodate margin in the design MTOW for potential mass growth during detailed design.
Source: Team-Added