# Requirement set Team01_StakeholderNeeds (R2025b)

## 1 [Cat1] Mission Capability (Container)

### 1.1 [N1] Runway Takeoff
The customer needs the aircraft to take off from the runway unassisted.
Source: RFP: Project objectives

### 1.2 [N2] Lap Count
The customer needs the aircraft to complete three full laps of the marked course.
Source: RFP: Project Objectives

### 1.3 [N3] Cruising Altitude
The customer needs the aircraft to reach a safe cruising altitude after takeoff
Source: RFP: Project requirements

### 1.4 [N4] Stable Approach
The customer needs the aircraft to perform a stabilized approach after the final lap
Source: RFP: Project Requirements

### 1.5 [N5]
The customer needs the aircraft to

### 1.6 [N6]
The customer needs the aircraft to